# Grasshopper definition Rail GH.gh (Grasshopper 1.0.4)

crv = Curve(<curve referenced from the Rhino model>)
crv_2 = Curve(<curve referenced from the Rhino model>)
flip = FlipCurve(Curve=crv)  # -> Curve, Flag
swp1 = Sweep1(Rail=flip.Curve, Sections=crv_2, Miter=1)
preview = CustomPreview(
    Geometry=swp1,
    Material={diffuse=RGB(221, 160, 221), emission=RGB(66, 48, 66), shine=0.5, specular=RGB(255, 255, 255), transparency=0})
